vi "Main.gvi"   [LabVIEW NXG 3.1.0]
panel controls:
  "User Input (Must be greater than 0)": i32 = 1
panel indicators:
  "output array": i32[]
  "array": T1[]
types:
  T1 = cluster{"String Constant": string, "Numeric Constant": i32, "Boolean Constant": bool}
diagram:
  w1 = [{"String Constant"="Mansion", "Numeric Constant"=0, "Boolean Constant"=FALSE}, {"String Constant"="Apartment", "Numeric Constant"=0, "Boolean Constant"=FALSE}, {"String Constant"="Shack", "Numeric Constant"=0, "Boolean Constant"=FALSE}, {"String Constant"="House", "Numeric Constant"=0, "Boolean Constant"=FALSE}, {"String Constant"="Batman", "Numeric Constant"=1, "Boolean Constant"=FALSE}, {"String Constant"="Wonder Woman", "Numeric Constant"=1, "Boolean Constant"=FALSE}, {"String Constant"="Black Panther", "Numeric Constant"=1, "Boolean Constant"=FALSE}, {"String Constant"="Jessica Jones", "Numeric Constant"=1, "Boolean Constant"=FALSE}, {"String Constant"="Farmer", "Numeric Constant"=2, "Boolean Constant"=FALSE}, {"String Constant"="Doctor", "Numeric Constant"=2, "Boolean Constant"=FALSE}, {"String Constant"="Marine Biologist", "Numeric Constant"=2, "Boolean Constant"=FALSE}, {"String Constant"="Dictator", "Numeric Constant"=2, "Boolean Constant"=FALSE}, {"String Constant"="Duck", "Numeric Constant"=3, "Boolean Constant"=FALSE}, {"String Constant"="Hippo", "Numeric Constant"=3, "Boolean Constant"=FALSE}, {"String Constant"="Seal", "Numeric Constant"=3, "Boolean Constant"=FALSE}, {"String Constant"="Ant farm", "Numeric Constant"=3, "Boolean Constant"=FALSE}, {"String Constant"="$4,000", "Numeric Constant"=4, "Boolean Constant"=FALSE}, {"String Constant"="$35,000", "Numeric Constant"=4, "Boolean Constant"=FALSE}, {"String Constant"="$85,000", "Numeric Constant"=4, "Boolean Constant"=FALSE}, {"String Constant"="$750,000", "Numeric Constant"=4, "Boolean Constant"=FALSE}, {"String Constant"="1", "Numeric Constant"=5, "Boolean Constant"=FALSE}, {"String Constant"="3", "Numeric Constant"=5, "Boolean Constant"=FALSE}, {"String Constant"="6", "Numeric Constant"=5, "Boolean Constant"=FALSE}, {"String Constant"="11", "Numeric Constant"=5, "Boolean Constant"=FALSE}, {"String Constant"="Motorcycle", "Numeric Constant"=6, "Boolean Constant"=FALSE}, {"String Constant"="VW Bug", "Numeric Constant"=6, "Boolean Constant"=FALSE}, {"String Constant"="Go Kart", "Numeric Constant"=6, "Boolean Constant"=FALSE}, {"String Constant"="Limo", "Numeric Constant"=6, "Boolean Constant"=FALSE}]
  w2 = $"User Input (Must be greater than 0)"
  w3 = 0  # Index Start
  s1 = [4, 4, 4, 4, 4, 4, 4]  # shift register
  s2 = w1  # shift register
  s3 = w3  # shift register
  while {
    Wait(time to wait=1750)
    w4 = 0  # Count Valid Cells
    s4 = s3  # shift register
    s5 = w4  # shift register
    while {
      Array Index(array=s2) -> (out0[s4]=w5)
      Property Node(instance in=w5) -> ("Numeric Constant"=w6, "Boolean Constant"=w7)
      Is Equal(x=w7, y=TRUE) -> w8
      Array Index(array=s1) -> (out0[w6]=w9)
      Is Equal(x=1, y=w9) -> w10
      Logical Or(w10, w8) -> w11
      case (w11) {
        frame True {
          w12 = s5
        }
        frame False {
          Increment(x=s5) -> w12
        }
      }
      Is Equal(x=w12, y=w2) -> w13
      case (w13) {
        frame True {
          w14 = s4
        }
        frame False {
          Increment(x=s4) -> w14
        }
      }
      Is Greater Or Equal(x=w14, y=28) -> w15
      case (w15) {
        frame True {
          Subtract(x=w14, y=28) -> w16
        }
        frame False {
          w16 = w14
        }
      }
      next s4 = w16
      next s5 = w12
      stop if w13
    }
    in-place {
      Array Index Replace Read Poser(array=s2) -> (out0[s4]=w17)
      case (w10) {
        frame True {
          w18 = w17
          w19 = s1
        }
        frame False {
          Property Node(instance in=w17, "Boolean Constant"=TRUE) -> ("Numeric Constant"=w20, instance out=w18)
          Array Index(array=s1) -> (out0[w20]=w21)
          Decrement(x=w21) -> w22
          Replace Array Subset(inArray=s1, index=w20, new=w22) -> w19
        }
      }
      Array Index Replace Write Poser(_, in=w18) -> (array=w23)
    }
    $array <- w23
    $"output array" <- w19
    Increment(x=s4) -> w24
    Array Index(array=w19) -> (out0[0]=w25, out1[1]=w26, out2[2]=w27, out3[3]=w28, out4[4]=w29, out5[5]=w30, out6[6]=w31)
    # Returns True if all values in the array are 1.
    Is Equal(x=w25, y=1) -> w32
    Is Equal(x=w26, y=1) -> w33
    Is Equal(x=w27, y=1) -> w34
    Is Equal(x=w28, y=1) -> w35
    Is Equal(x=w29, y=1) -> w36
    Is Equal(x=w30, y=1) -> w37
    Is Equal(x=w31, y=1) -> w38
    Logical And(w32, w33, w34, w35, w36, w37, w38) -> w39
    next s1 = w19
    next s2 = w23
    next s3 = w24
    stop if w39
  }
